# Grasshopper definition xmlTest.ghx (Grasshopper 1.0.7)

panel = Panel("sample(2021-11-24)-final-fix(xxx).ghx")
multiplication = Multiplication(A="8", B=Slider(0.25, range=0..1))
sph = Sphere(Base=PlaneXY(0, 0, 0), Radius=multiplication)
